# Grasshopper definition A3_Grasshopper_File.gh (Grasshopper 1.0.8)
# plug-ins: Pufferfish, LunchBox, Weaverbird

# ---- group: Original
X = UnitX(Factor=1)
pt = ConstructPoint(XCoordinate=Slider(47.884, range=0..100), YCoordinate=0, ZCoordinate=0)
pt_2 = ConstructPoint(XCoordinate=0, YCoordinate=0, ZCoordinate=Slider(51.014, range=0..100))
pt_3 = ConstructPoint(XCoordinate=0, YCoordinate=0, ZCoordinate=0)
arc = ArcSED(Start=pt_2, End=pt, Direction=X)  # -> Arc, Plane, Radius
ln = Line(StartPoint=pt_3, EndPoint=pt_2)
revsrf = Revolution(Curve=arc.Arc, Axis=ln, Domain=Domain(0, 6.283185307))
cap = CapHoles(Brep=revsrf)

X_2 = UnitX(Factor=1)
pt_4 = ConstructPoint(XCoordinate=Slider(47.884, range=0..100), YCoordinate=0, ZCoordinate=0)
pt_5 = ConstructPoint(XCoordinate=0, YCoordinate=0, ZCoordinate=Slider(51.014, range=0..100))
pt_6 = ConstructPoint(XCoordinate=0, YCoordinate=0, ZCoordinate=0)
arc_2 = ArcSED(Start=pt_5, End=pt_4, Direction=X_2)  # -> Arc, Plane, Radius
ln_2 = Line(StartPoint=pt_6, EndPoint=pt_5)
revsrf_2 = Revolution(Curve=arc_2.Arc, Axis=ln_2, Domain=Domain(0, 6.283185307))
cap_2 = CapHoles(Brep=revsrf_2)

# ----
# DOME 1
number_slider = Slider(60, range=0..100)
divide = DivideCurve(Curve=revsrf_2, Count=number_slider, Kinks=False)  # -> Points, Tangents, Parameters
ln_3 = Line(StartPoint=pt_5, EndPoint=divide.Points)
pull = PullCurve(Curve=ln_3, Surface=revsrf_2)
preview = CustomPreview(Geometry=cap_2, Material=ColourSwatch(SwatchColor=RGB(212, 205, 182)))
xy = XYPlane(Origin=Point(0, 0, 0))
X_3 = UnitX(Factor=Slider(4000, range=-1000..4000))
Y = UnitY(Factor=Slider(-134, range=-2000..2001))
pl = PlaneNormal(Origin=xy, ZAxis=Vector(0, 0, 1))
addition = Addition(A=X_3, B=Y)
pl_2 = PlaneNormal(Origin=ln_3, ZAxis=divide.Points)
number_slider_2 = Slider(1, range=0..100)
amp = Amplitude(Vector=addition, Amplitude=Slider(-199, range=-299..300))
pull_2 = PullCurve(Curve=ln_3, Surface=revsrf_2)
move = Move(Geometry=revsrf_2, Motion=amp)  # -> Geometry, Transform
offcrv = OffsetCurve(Curve=[pl_2, pull], Plane=PlaneXY(0, 0, 0), Distance=Slider(7, range=0..10), BothSides=0, Kinks=0, CapType=1)
divide_2 = DivideCurve(Curve=[pull_2, pull], Count=Slider(10, range=0..10), Kinks=False)  # -> Points, Tangents, Parameters
cir = Circle(Plane=PlaneXY(0, 0, 0), Radius=Slider(50, range=0..100))
pipe = Pipe(Curve=pull, Radius=number_slider_2, Caps=0, FitRail=False)
pipe_2 = Pipe(Curve=pull_2, Radius=number_slider_2, Caps=0, FitRail=False)
rot3d = Rotate3D(Geometry=move.Geometry, Angle=degrees(Slider(3463, range=0..5000)), Center=Point(0, 0, 0), Axis=Vector(0, 0, 1))  # -> Geometry, Transform
Z = UnitZ(Factor=1)
del = DelaunayMesh(Points=flatten(divide_2.Points), Plane=PlaneXY(0, 0, 0))
pl_3 = PlaneNormal(Origin=divide_2.Points, ZAxis=divide_2.Points)
cpoly = ControlPolygon(Curve=cir)  # -> Polygon, Points
medges = MeshEdges(Mesh=del)  # -> NakedEdges, InteriorEdges, NonManifoldEdges
cone = Cone(Base=pl_3, Radius=Slider(1, range=0..50), Length=Slider(2, range=0..50))  # -> Cone, Tip
number_slider_3 = Slider(0.595, range=0..10)
amp_2 = Amplitude(Vector=Z, Amplitude=Slider(8, range=0..100))
number_slider_4 = Slider(20, range=0..100)
explode = Explode(Curve=cpoly.Polygon, Recursive=True)  # -> Segments, Vertices
pipe_3 = Pipe(Curve=[medges.NakedEdges, medges.InteriorEdges, medges.NonManifoldEdges], Radius=number_slider_3, Caps=0, FitRail=False)
move_2 = Move(Geometry=cir, Motion=amp_2)  # -> Geometry, Transform
range = Range(Domain=Domain(0, 1), Steps=number_slider_4)
pipe_4 = Pipe(Curve=[medges.NakedEdges, medges.InteriorEdges, medges.NonManifoldEdges], Radius=number_slider_3, Caps=0, FitRail=False)
item = ListItem(List=explode.Segments, Index=0, Wrap=True)  # -> Item, Item1, Item2, Item3
divide_3 = DivideCurve(Curve=move_2.Geometry, Count=Slider(10, range=0..10), Kinks=False)  # -> Points, Tangents, Parameters
graph = GraphMapper(range, x0=0, x1=1, y0=0, y1=1, container_name="Bezier", cpx=[0, 0, 1, 1], cpy=[0, 0, 0, 0])
pl_4 = PlaneNormal(Origin=divide_3.Points, ZAxis=divide_3.Points)
dom = ConstructDomain(DomainStart=0, DomainEnd=Slider(10, range=0..10))
divide_4 = DivideCurve(Curve=item.Item2, Count=number_slider_4, Kinks=False)  # -> Points, Tangents, Parameters
remap = RemapNumbers(Value=graph, Source=Domain(0, 1), Target=dom)  # -> Mapped, Clipped
swatch = ColourSwatch(SwatchColor=RGB(255, 255, 255))
Z_2 = UnitZ(Factor=remap.Mapped)
move_3 = Move(Geometry=divide_4.Points, Motion=Z_2)  # -> Geometry, Transform
cone_2 = Cone(Base=pl_4, Radius=Slider(5, range=0..50), Length=Slider(17, range=0..50))  # -> Cone, Tip
len = Length(Curve=item.Item3)
preview_2 = CustomPreview(Geometry=[pipe, pipe_4], Material=ColourSwatch(SwatchColor=RGB(212, 205, 182)))
intcrv = Interpolate(Vertices=move_3.Geometry, Degree=3, Periodic=False, KnotStyle=1)  # -> Curve, Length, Domain
join = JoinCurves(Curves=[intcrv.Curve, item.Item1], Preserve=False)
amp_3 = Amplitude(Vector=item.Item3, Amplitude=expr("X*2", len))
offset = OffsetCurve(Curve=cir, Distance="-2", Corners=1)
swatch_2 = ColourSwatch(SwatchColor=RGB(245, 242, 232))
divide_5 = DivideCurve(Curve=offset, Count=Slider(100, range=0..100), Kinks=False)  # -> Points, Tangents, Parameters
panel = Panel("""0
4
7.5
11.5
15""")
extr = Extrude(Base=join, Direction=amp_3)
project = ProjectCurve(Curve=cir, Brep=extr, Direction=Vector(0, 0, 1))  # -> flatten(Curve)
pline = PolyLine(Vertices=divide_5.Points, Closed=invert(False))
preview_3 = CustomPreview(Geometry=cone.Cone, Material=ColourSwatch(SwatchColor=RGB(255, 214, 255)))
Z_3 = UnitZ(Factor=Slider(16, range=0..100))
Z_4 = UnitZ(Factor=panel)
join_2 = JoinCurves(Curves=project, Preserve=False)
swatch_3 = ColourSwatch(SwatchColor=RGB(255, 255, 255))
move_4 = Move(Geometry=pline, Motion=Z_4)  # -> Geometry, Transform
panel_2 = Panel("""0
2
4""")
number_slider_5 = Slider(200, range=0..1000)
move_5 = Move(Geometry=cir, Motion=Z_3)  # -> Geometry, Transform
item_2 = ListItem(List=move_4.Geometry, Index=panel_2, Wrap=True)
divide_6 = DivideCurve(Curve=move_5.Geometry, Count=number_slider_5, Kinks=False)  # -> Points, Tangents, Parameters
preview_4 = CustomPreview(Geometry=cone_2.Cone, Material=ColourSwatch(SwatchColor=RGB(255, 214, 255)))
weave = Weave(Pattern=[0, 1], Stream0=move_4.Geometry, Stream1=move_4.Geometry, NullGaps=False)
divide_7 = DivideCurve(Curve=join_2, Count=number_slider_5, Kinks=False)  # -> Points, Tangents, Parameters
alongcrv = SortAlongCurve(Points=divide_7.Points, Curve=cir)  # -> Points, Indices
swatch_4 = ColourSwatch(SwatchColor=RGB(255, 255, 255))
lng = ListLength(List=weave)  # -> expr("X-1", Length)
number_slider_6 = Slider(4, range=0..10)
pframe = PerpFrame(Curve=move_5.Geometry, Parameter=divide_6.Parameters)
pi = Pi(Factor=1)
ln_4 = Line(StartPoint=divide_6.Points, EndPoint=alongcrv.Points)
subtraction = Subtraction(A=number_slider_6, B="2")
deplane = DeconstructPlane(Plane=pframe)  # -> Origin, XAxis, YAxis, ZAxis
cull_i = CullIndex(List=item_2, Indices="0", Wrap=True)
Z_5 = UnitZ(Factor=1)
cull_i_2 = CullIndex(List=weave, Indices=flatten([lng, "0"]), Wrap=True)
number_slider_7 = Slider(0.1, range=0..0.1)
offset_2 = OffsetCurve(Curve=cull_i, Distance="8", Corners=1)
series = Series(Start=expr("X/2", pi), Step="0", Count=subtraction)
series_2 = Series(Start=pi, Step="0", Count="3")
divide_8 = DivideCurve(Curve=ln_4, Count=number_slider_6, Kinks=False)  # -> Points, Tangents, Parameters
pl_5 = ConstructPlane(Origin=deplane.Origin, XAxis=deplane.XAxis, YAxis=deplane.ZAxis)  # -> graft(Plane)
merge = Merge(Data1=graft(cull_i), Data2=offset_2)
partition = PartitionList(List=cull_i_2, Size="2")
swatch_5 = ColourSwatch(SwatchColor=RGB(255, 255, 255))
extr_2 = Extrude(Base=offset_2, Direction=Z_5)
move2pt = MoveToPoint(Geometry=pl_5, PointA=pl_5, PointB=divide_8.Points)  # -> Moved, Vector, Transform
ins = InsertItems(List=series, Item=series_2, Indices="2", Wrap=True)
loft = Loft(Curves=merge, Options={Adjust=False, Closed=False, LoftEnds=0, LoftSimp=0, LoftType=0, Rebuild=10, Refit=0.01})
dom_2 = ConstructDomain(DomainStart=number_slider_7, DomainEnd=number_slider_7)
cap_3 = CapHoles(Brep=extr_2)
loft_2 = Loft(Curves=partition, Options={Adjust=False, Closed=False, LoftEnds=0, LoftSimp=0, LoftType=0, Rebuild=10, Refit=0.01})
rectangle = Rectangle(Plane=move2pt.Moved, XSize=Slider(1, range=0..10), YSize=dom_2, Radius=0)  # -> Rectangle, Length
rotate = Rotate(Geometry=rectangle.Rectangle, Angle=ins, Plane=move2pt.Moved)  # -> Geometry, Transform
debrep = DeconstructBrep(Brep=[loft, loft_2])  # -> Faces, Edges, Vertices
loft_opt = LoftOptions(Closed=False, Adjust=False, Rebuild=0, Refit=0, Type="1")
wires = BrepWireframe(Brep=debrep.Faces, Density=-1)
loft_3 = Loft(Curves=rotate.Geometry, Options=loft_opt)
join_3 = JoinCurves(Curves=wires, Preserve=False)
offset_3 = OffsetCurve(Curve=join_3, Distance=expr("-x", Slider(0.01, range=0..0.01)), Corners=1)
cap_4 = CapHoles(Brep=loft_3)
srf = Surface(offset_3)
preview_5 = CustomPreview(Geometry=srf, Material=ColourSwatch(SwatchColor=RGB(212, 205, 182)))
merge_2 = Merge(Data1=simplify(join_3), Data2=simplify(offset_3))
loft_4 = Loft(Curves=merge_2, Options={Adjust=False, Closed=False, LoftEnds=0, LoftSimp=0, LoftType=0, Rebuild=10, Refit=0.01})
preview_6 = CustomPreview(Geometry=[loft_4, cap_3, loft_3, cap_4], Material=ColourSwatch(SwatchColor=RGB(255, 214, 255)))

divide_9 = DivideCurve(Curve=revsrf, Count=Slider(60, range=0..100), Kinks=False)  # -> Points, Tangents, Parameters
ln_5 = Line(StartPoint=pt_2, EndPoint=divide_9.Points)
preview_7 = CustomPreview(Geometry=cap, Material=ColourSwatch(SwatchColor=RGB(255, 255, 255)))
pull_3 = PullCurve(Curve=ln_5, Surface=revsrf)
pl_6 = PlaneNormal(Origin=ln_5, ZAxis=divide_9.Points)
offcrv_2 = OffsetCurve(Curve=[pl_6, pull_3], Plane=PlaneXY(0, 0, 0), Distance=Slider(7, range=0..10), BothSides=0, Kinks=0, CapType=1)
pipe_5 = Pipe(Curve=pull_3, Radius=Slider(1, range=0..100), Caps=0)
divide_10 = DivideCurve(Curve=[pull_2, pull_3], Count=Slider(4, range=0..10), Kinks=False)  # -> Points, Tangents, Parameters
cir_2 = Circle(Plane=PlaneXY(0, 0, 0), Radius=Slider(50, range=0..100))
Z_6 = UnitZ(Factor=1)
del_2 = DelaunayMesh(Points=flatten(divide_10.Points), Plane=PlaneXY(0, 0, 0))
pl_7 = PlaneNormal(Origin=divide_10.Points, ZAxis=divide_10.Points)
cpoly_2 = ControlPolygon(Curve=cir_2)  # -> Polygon, Points
medges_2 = MeshEdges(Mesh=del_2)  # -> NakedEdges, InteriorEdges, NonManifoldEdges
cone_3 = Cone(Base=pl_7, Radius=Slider(1, range=0..50), Length=Slider(2, range=0..50))  # -> Cone, Tip
amp_4 = Amplitude(Vector=Z_6, Amplitude=Slider(8, range=0..100))
number_slider_8 = Slider(20, range=0..100)
explode_2 = Explode(Curve=cpoly_2.Polygon, Recursive=True)  # -> Segments, Vertices
move_6 = Move(Geometry=cir_2, Motion=amp_4)  # -> Geometry, Transform
pipe_6 = Pipe(
    Curve=[medges_2.NakedEdges, medges_2.InteriorEdges, medges_2.NonManifoldEdges],
    Radius=Slider(0.595, range=0..10),
    Caps=0)
range_2 = Range(Domain=Domain(0, 1), Steps=number_slider_8)
item_3 = ListItem(List=explode_2.Segments, Index=0, Wrap=True)  # -> Item, Item1, Item2, Item3
divide_11 = DivideCurve(Curve=move_6.Geometry, Count=Slider(10, range=0..10), Kinks=False)  # -> Points, Tangents, Parameters
graph_2 = GraphMapper(range_2, x0=0, x1=1, y0=0, y1=1, container_name="Bezier", cpx=[0, 0, 1, 1], cpy=[0, 0, 0, 0])
pl_8 = PlaneNormal(Origin=divide_11.Points, ZAxis=divide_11.Points)
dom_3 = ConstructDomain(DomainStart=0, DomainEnd=Slider(10, range=0..10))
divide_12 = DivideCurve(Curve=item_3.Item2, Count=number_slider_8, Kinks=False)  # -> Points, Tangents, Parameters
remap_2 = RemapNumbers(Value=graph_2, Source=Domain(0, 1), Target=dom_3)  # -> Mapped, Clipped
Z_7 = UnitZ(Factor=remap_2.Mapped)
move_7 = Move(Geometry=divide_12.Points, Motion=Z_7)  # -> Geometry, Transform
cone_4 = Cone(Base=pl_8, Radius=Slider(5, range=0..50), Length=Slider(50, range=0..50))  # -> Cone, Tip
len_2 = Length(Curve=item_3.Item3)
preview_8 = CustomPreview(Geometry=[pipe_5, pipe_6], Material=ColourSwatch(SwatchColor=RGB(255, 195, 173)))
intcrv_2 = Interpolate(Vertices=move_7.Geometry, Degree=3, Periodic=False, KnotStyle=1)  # -> Curve, Length, Domain
join_4 = JoinCurves(Curves=[intcrv_2.Curve, item_3.Item1], Preserve=False)
amp_5 = Amplitude(Vector=item_3.Item3, Amplitude=expr("X*2", len_2))
offset_4 = OffsetCurve(Curve=cir_2, Distance="-2", Corners=1)
divide_13 = DivideCurve(Curve=offset_4, Count=Slider(100, range=0..100), Kinks=False)  # -> Points, Tangents, Parameters
panel_3 = Panel("""0
4
7.5
11.5
15""")
preview_9 = CustomPreview(Geometry=cone_3.Cone, Material=ColourSwatch(SwatchColor=RGB(245, 242, 232)))
extr_3 = Extrude(Base=join_4, Direction=amp_5)
project_2 = ProjectCurve(Curve=cir_2, Brep=extr_3, Direction=Vector(0, 0, 1))  # -> flatten(Curve)
pline_2 = PolyLine(Vertices=divide_13.Points, Closed=invert(False))
Z_8 = UnitZ(Factor=Slider(16, range=0..100))
Z_9 = UnitZ(Factor=panel_3)
join_5 = JoinCurves(Curves=project_2, Preserve=False)
move_8 = Move(Geometry=pline_2, Motion=Z_9)  # -> Geometry, Transform
panel_4 = Panel("""0
2
4""")
number_slider_9 = Slider(200, range=0..1000)
move_9 = Move(Geometry=cir_2, Motion=Z_8)  # -> Geometry, Transform
item_4 = ListItem(List=move_8.Geometry, Index=panel_4, Wrap=True)
divide_14 = DivideCurve(Curve=move_9.Geometry, Count=number_slider_9, Kinks=False)  # -> Points, Tangents, Parameters
preview_10 = CustomPreview(Geometry=cone_4.Cone, Material=ColourSwatch(SwatchColor=RGB(245, 242, 232)))
weave_2 = Weave(Pattern=[0, 1], Stream0=move_8.Geometry, Stream1=move_8.Geometry, NullGaps=False)
divide_15 = DivideCurve(Curve=join_5, Count=number_slider_9, Kinks=False)  # -> Points, Tangents, Parameters
alongcrv_2 = SortAlongCurve(Points=divide_15.Points, Curve=cir_2)  # -> Points, Indices
lng_2 = ListLength(List=weave_2)  # -> expr("X-1", Length)
number_slider_10 = Slider(8, range=0..10)
pframe_2 = PerpFrame(Curve=move_9.Geometry, Parameter=divide_14.Parameters)
pi_2 = Pi(Factor=1)
ln_6 = Line(StartPoint=divide_14.Points, EndPoint=alongcrv_2.Points)
subtraction_2 = Subtraction(A=number_slider_10, B="2")
deplane_2 = DeconstructPlane(Plane=pframe_2)  # -> Origin, XAxis, YAxis, ZAxis
cull_i_3 = CullIndex(List=item_4, Indices="0", Wrap=True)
Z_10 = UnitZ(Factor=1)
cull_i_4 = CullIndex(List=weave_2, Indices=flatten([lng_2, "0"]), Wrap=True)
number_slider_11 = Slider(0.1, range=0..0.1)
offset_5 = OffsetCurve(Curve=cull_i_3, Distance="8", Corners=1)
series_3 = Series(Start=expr("X/2", pi_2), Step="0", Count=subtraction_2)
series_4 = Series(Start=pi_2, Step="0", Count="3")
divide_16 = DivideCurve(Curve=ln_6, Count=number_slider_10, Kinks=False)  # -> Points, Tangents, Parameters
pl_9 = ConstructPlane(Origin=deplane_2.Origin, XAxis=deplane_2.XAxis, YAxis=deplane_2.ZAxis)  # -> graft(Plane)
merge_3 = Merge(Data1=graft(cull_i_3), Data2=offset_5)
partition_2 = PartitionList(List=cull_i_4, Size="2")
extr_4 = Extrude(Base=offset_5, Direction=Z_10)
move2pt_2 = MoveToPoint(Geometry=pl_9, PointA=pl_9, PointB=divide_16.Points)  # -> Moved, Vector, Transform
ins_2 = InsertItems(List=series_3, Item=series_4, Indices="2", Wrap=True)
loft_5 = Loft(Curves=merge_3, Options={Adjust=False, Closed=False, LoftEnds=0, LoftSimp=0, LoftType=0, Rebuild=10, Refit=0.01})
dom_4 = ConstructDomain(DomainStart=number_slider_11, DomainEnd=number_slider_11)
cap_5 = CapHoles(Brep=extr_4)
loft_6 = Loft(Curves=partition_2, Options={Adjust=False, Closed=False, LoftEnds=0, LoftSimp=0, LoftType=0, Rebuild=10, Refit=0.01})
rectangle_2 = Rectangle(Plane=move2pt_2.Moved, XSize=Slider(1, range=0..1), YSize=dom_4, Radius=0)  # -> Rectangle, Length
rotate_2 = Rotate(Geometry=rectangle_2.Rectangle, Angle=ins_2, Plane=move2pt_2.Moved)  # -> Geometry, Transform
debrep_2 = DeconstructBrep(Brep=[loft_5, loft_6])  # -> Faces, Edges, Vertices
loft_opt_2 = LoftOptions(Closed=False, Adjust=False, Rebuild=0, Refit=0, Type="1")
wires_2 = BrepWireframe(Brep=debrep_2.Faces, Density=-1)
loft_7 = Loft(Curves=rotate_2.Geometry, Options=loft_opt_2)
join_6 = JoinCurves(Curves=wires_2, Preserve=False)
offset_6 = OffsetCurve(Curve=join_6, Distance=expr("-x", Slider(0.01, range=0..0.01)), Corners=1)
cap_6 = CapHoles(Brep=loft_7)
srf_2 = Surface(offset_6)
preview_11 = CustomPreview(Geometry=srf_2, Material=ColourSwatch(SwatchColor=RGB(120, 85, 55)))
merge_4 = Merge(Data1=simplify(join_6), Data2=simplify(offset_6))
loft_8 = Loft(Curves=merge_4, Options={Adjust=False, Closed=False, LoftEnds=0, LoftSimp=0, LoftType=0, Rebuild=10, Refit=0.01})
preview_12 = CustomPreview(Geometry=[loft_8, cap_5, loft_7, cap_6], Material=ColourSwatch(SwatchColor=RGB(230, 170, 160)))
# DOME 2
merge_5 = Merge(Data1=loft_8, Data2=srf_2, Data3=cap_6)

# ---- group: TUNNEL
pt_7 = ConstructPoint(XCoordinate=0, YCoordinate=0, ZCoordinate=0)
cir_3 = Circle(Plane=pt_7, Radius=Slider(19.2, range=0..100))
ln_7 = Line(StartPoint=pt_7, EndPoint=cir_3)
end = EndPoints(Curve=ln_7)  # -> Start, End
number_slider_12 = Slider(95.82, range=0..100)
X_4 = UnitX(Factor=1)
Y_2 = UnitY(Factor=1)
neg = Negative(Value=number_slider_12)
line = LineSDL(Start=end.Start, Direction=X_4, Length=number_slider_12)
line_2 = LineSDL(Start=end.End, Direction=Y_2, Length=neg)
neg_2 = Negative(Value=Slider(0.7, range=0..1))
join_7 = JoinCurves(Curves=[line, line_2], Preserve=False)
Z_11 = UnitZ(Factor=neg_2)
number_slider_13 = Slider(23.11, range=0..30)
fillet = Fillet(Curve=join_7, Radius=Slider(100, range=0..100))
toggle = BooleanToggle(False)
subtraction_3 = Subtraction(A=number_slider_13, B=Slider(0.41, range=0..1))
offset_7 = OffsetCurve(Curve=fillet, Distance=number_slider_13, Corners=toggle)
loft_9 = Loft(
    Curves=flatten([fillet, offset_7]),
    Options={Adjust=False, Closed=False, LoftEnds=0, LoftSimp=0, LoftType=0, Rebuild=10, Refit=0.01})
extr_5 = Extrude(Base=loft_9, Direction=Z_11)
Z_12 = UnitZ(Factor=subtraction_3)
division = Division(A=number_slider_13, B=Slider(2, range=0..10))
Z_13 = UnitZ(Factor=1)
move_10 = Move(Geometry=offset_7, Motion=Z_12)  # -> Geometry, Transform
number_slider_14 = Slider(11, range=0..100)
Z_14 = UnitZ(Factor=Slider(10, range=0..10))
move_11 = Move(Geometry=offset_7, Motion=Z_14)  # -> Geometry, Transform
amp_6 = Amplitude(Vector=Z_13, Amplitude=Slider(25, range=0..30))
offset_8 = OffsetCurve(Curve=fillet, Distance=division, Corners=toggle)
crv = Curve(move_10.Geometry)
crv_2 = Curve(move_11.Geometry)
crv_3 = Curve(fillet)
crv_4 = Curve(offset_7)
move_12 = Move(Geometry=crv_3, Motion=amp_6)  # -> Geometry, Transform
divide_17 = DivideCurve(Curve=offset_8, Count=number_slider_14, Kinks=False)  # -> Points, Tangents, Parameters
# INNER TWIST
number_slider_15 = Slider(0, range=0..100)
loft_opt_3 = LoftOptions(Closed=False, Adjust=False, Rebuild=Slider(100, range=0..100), Refit=0, Type=0)
loft_10 = Loft(Curves=flatten([crv, crv_2, crv_3, crv_4, move_12.Geometry]), Options=loft_opt_3)
cull_i_5 = CullIndex(List=divide_17.Points, Indices=[number_slider_14, number_slider_15], Wrap=True)
crv_5 = Curve(loft_10)
diamond = DiamondPanels(Surface=loft_10, UDivisions=Slider(2, range=0..10), VDivisions=Slider(39, range=0..100))  # -> DiamondPanels, TriPanels
end_2 = EndPoints(Curve=crv_5)  # -> Start, End
crv_6 = Curve(diamond.DiamondPanels)
crv_7 = Curve(diamond.TriPanels)
mp = MultiPipe(
    Curves=[crv_7, crv_6],
    NodeSize=Slider(0.47, range=0..1),
    EndOffset=Slider(0, range=0..10),
    StrutSize=Slider(0.26, range=0..1),
    Segment=0,
    KinkAngle=0.6,
    CubeFit=0,
    Caps=0)
randomsplit = RandomSplitList(MasterList=[diamond.DiamondPanels, diamond.TriPanels], Seed=2, Split=0.5)  # -> ListA, ListB
X_5 = UnitX(Factor=Slider(54, range=0..1000))
Y_3 = UnitY(Factor=Slider(1000, range=0..1000))
addition_2 = Addition(A=X_5, B=Y_3)
amp_7 = Amplitude(Vector=addition_2, Amplitude=Slider(133, range=-299..300))
move_13 = Move(Geometry=[mp, cull_i_5, extr_5], Motion=amp_7)  # -> Geometry, Transform
# TUNNEL
preview_13 = CustomPreview(Geometry=move_13.Geometry, Material=ColourSwatch(SwatchColor=RGB(212, 205, 182)))

# ---- group: RIBBONS
cir_4 = Circle(Plane=PlaneXY(0, 0, 0), Radius=Slider(26, range=0..100))
Z_15 = UnitZ(Factor=1)
series_5 = Series(Start=Slider(0, range=0..100), Step=Slider(24, range=0..100), Count=Slider(8, range=0..10))
amp_8 = Amplitude(Vector=Z_15, Amplitude=series_5)
dom_5 = ConstructDomain(DomainStart=Slider(1, range=0..1), DomainEnd=Slider(0.01, range=0..0.1))
range_3 = Range(Domain=dom_5, Steps=Slider(7, range=0..10))
pt_8 = ConstructPoint(XCoordinate=Slider(0, range=0..100), YCoordinate=Slider(0, range=0..100), ZCoordinate=Slider(0, range=0..100))
scale = Scale(Geometry=cir_4, Center=pt_8, Factor=range_3)  # -> Geometry, Transform
move_14 = Move(Geometry=scale.Geometry, Motion=amp_8)  # -> Geometry, Transform
series_6 = Series(Start=Slider(0, range=0..100), Step=Slider(20, range=0..100), Count=Slider(6, range=0..10))
rotate_3 = Rotate(Geometry=move_14.Geometry, Angle=series_6, Plane=PlaneXY(0, 0, 0))  # -> Geometry, Transform
divide_18 = DivideCurve(Curve=rotate_3.Geometry, Count=Slider(4, range=0..10), Kinks=False)  # -> Points, Tangents, Parameters
flip = FlipMatrix(Data=divide_18.Points)
divide_19 = DivideCurve(Curve=rotate_3.Geometry, Count=Slider(4, range=0..10), Kinks=False)  # -> Points, Tangents, Parameters
Y_4 = UnitY(Factor=1)
intcrv_3 = Interpolate(Vertices=flip, Degree=3, Periodic=False, KnotStyle=1)  # -> Curve, Length, Domain
amp_9 = Amplitude(Vector=Y_4, Amplitude=Slider(2, range=-200..201))
move_15 = Move(Geometry=divide_19.Points, Motion=amp_9)  # -> Geometry, Transform
Z_16 = UnitZ(Factor=1)
flip_2 = FlipMatrix(Data=move_15.Geometry)
Z_17 = UnitZ(Factor=1)
amp_10 = Amplitude(Vector=Z_16, Amplitude=Slider(16, range=0..30))
move_16 = Move(Geometry=intcrv_3.Curve, Motion=amp_10)  # -> Geometry, Transform
intcrv_4 = Interpolate(Vertices=flip_2, Degree=3, Periodic=False, KnotStyle=1)  # -> Curve, Length, Domain
number_slider_16 = Slider(3, range=0..10)
loft_11 = Loft(
    Curves=[intcrv_3.Curve, move_16.Geometry],
    Options={Adjust=False, Closed=False, LoftEnds=0, LoftSimp=0, LoftType=0, Rebuild=10, Refit=0.01})
Y_5 = UnitY(Factor=number_slider_16)
Z_18 = UnitZ(Factor=number_slider_16)
divide_20 = DivideCurve(Curve=rotate_3.Geometry, Count=Slider(4, range=0..10), Kinks=False)  # -> Points, Tangents, Parameters
offset_9 = OffsetSurface(Surface=loft_11, Distance=0, Retrim=True)
amp_11 = Amplitude(Vector=Z_17, Amplitude=Slider(4, range=0..100))
extr_6 = Extrude(Base=offset_9, Direction=Y_5)
move_17 = Move(Geometry=divide_20.Points, Motion=amp_11)  # -> Geometry, Transform
flip_3 = FlipMatrix(Data=move_17.Geometry)
cap_7 = CapHoles(Brep=extr_6)
intcrv_5 = Interpolate(Vertices=flip_3, Degree=3, Periodic=False, KnotStyle=1)  # -> Curve, Length, Domain
join_8 = JoinCurves(Curves=[intcrv_3.Curve, intcrv_5.Curve], Preserve=False)
merge_6 = Merge(Data1=intcrv_3.Curve, Data2=intcrv_4.Curve, Data3=intcrv_5.Curve)
loft_12 = Loft(
    Curves=[merge_6, join_8],
    Options={Adjust=False, Closed=False, LoftEnds=0, LoftSimp=0, LoftType=0, Rebuild=10, Refit=0.01})
offset_10 = OffsetSurface(Surface=loft_12, Distance=0, Retrim=True)
preview_14 = CustomPreview(Geometry=offset_10, Material=ColourSwatch(SwatchColor=RGB(245, 242, 235)))

# ----
X_6 = UnitX(Factor=Slider(4000, range=-1000..4000))
Y_6 = UnitY(Factor=Slider(-134, range=-2000..2001))
addition_3 = Addition(A=X_6, B=Y_6)
amp_12 = Amplitude(Vector=addition_3, Amplitude=Slider(-199, range=-299..300))
move_18 = Move(Geometry=pipe_6, Motion=amp_12)  # -> Geometry, Transform
rot3d_2 = Rotate3D(Geometry=move_18.Geometry, Angle=degrees(Slider(3463, range=0..5000)), Center=Point(0, 0, 0), Axis=Vector(0, 0, 1))  # -> Geometry, Transform
preview_15 = CustomPreview(Geometry=rot3d_2.Geometry, Material=ColourSwatch(SwatchColor=RGB(212, 205, 182)))
X_7 = UnitX(Factor=Slider(4000, range=-1000..4000))
Y_7 = UnitY(Factor=Slider(-134, range=-2000..2001))
addition_4 = Addition(A=X_7, B=Y_7)
amp_13 = Amplitude(Vector=addition_4, Amplitude=Slider(-199, range=-299..300))
move_19 = Move(Geometry=cone_4.Cone, Motion=amp_13)  # -> Geometry, Transform
rot3d_3 = Rotate3D(Geometry=move_19.Geometry, Angle=degrees(Slider(3463, range=0..5000)), Center=Point(0, 0, 0), Axis=Vector(0, 0, 1))  # -> Geometry, Transform
preview_16 = CustomPreview(Geometry=rot3d_3.Geometry, Material=ColourSwatch(SwatchColor=RGB(212, 205, 182)))
X_8 = UnitX(Factor=Slider(4000, range=-1000..4000))
Y_8 = UnitY(Factor=Slider(-134, range=-2000..2001))
addition_5 = Addition(A=X_8, B=Y_8)
amp_14 = Amplitude(Vector=addition_5, Amplitude=Slider(-199, range=-299..300))
# DOME MOVE
move_20 = Move(Geometry=cap_5, Motion=amp_14)  # -> Geometry, Transform
rot3d_4 = Rotate3D(Geometry=move_20.Geometry, Angle=degrees(Slider(3463, range=0..5000)), Center=Point(0, 0, 0), Axis=Vector(0, 0, 1))  # -> Geometry, Transform
preview_17 = CustomPreview(Geometry=rot3d_4.Geometry, Material=ColourSwatch(SwatchColor=RGB(222, 255, 255)))

# ---- group: TOWER
Z_19 = UnitZ(Factor=Slider(193, range=0..1000))
ellipse = Ellipse(Plane=PlaneXY(0, 0, 0), Radius1=Slider(26, range=0..100), Radius2=Slider(21, range=0..100))  # -> Ellipse, Focus1, Focus2
move_21 = Move(Geometry=ellipse.Ellipse, Motion=Z_19)  # -> Geometry, Transform
area = Area(Geometry=ellipse.Ellipse)  # -> Area, Centroid
area_2 = Area(Geometry=move_21.Geometry)  # -> Area, Centroid
scale_2 = Scale(Geometry=move_21.Geometry, Center=area_2.Centroid, Factor=Slider(-0.03, range=-1..0))  # -> Geometry, Transform
loft_13 = Loft(
    Curves=[scale_2.Geometry, ellipse.Ellipse],
    Options={Adjust=False, Closed=False, LoftEnds=0, LoftSimp=0, LoftType=0, Rebuild=10, Refit=0.01})
ln_8 = Line(StartPoint=area.Centroid, EndPoint=area_2.Centroid)
number_slider_17 = Slider(8, range=0..10)
twist = Twist(Geometry=loft_13, Axis=ln_8, Angle=degrees(Slider(378, range=0..1000)), Infinite=False, Rigid=False)
debrep_3 = DeconstructBrep(Brep=twist)  # -> Faces, Edges, Vertices
mesh_uv = MeshSurface(Surface=debrep_3.Faces, UCount=number_slider_17, VCount=number_slider_17, Overhang=True, Equalize=False)
wbframe = WeaverbirdsPictureFrame(MeshPolylines=mesh_uv, Distance=5, InsetType=0)  # -> flatten(OutMesh)
mjoin = MeshJoin(Meshes=wbframe)
wbthicken = WeaverbirdsMeshThicken(MeshCurves=mjoin, Distance=Slider(1, range=0..10), OffsetType=0)  # -> flatten(OutputMeshCurves)
wbcatmullclark = WeaverbirdsCatmullClarkSubdivision(MeshCurves=wbthicken, Level=Slider(3, range=0..10), SmoothNakedEdges=1)
swatch_6 = ColourSwatch(SwatchColor=RGB(255, 255, 255))
preview_18 = CustomPreview(Geometry=[wbthicken, wbcatmullclark], Material=ColourSwatch(SwatchColor=RGB(212, 205, 182)))

# ----
preview_19 = CustomPreview(Geometry=cap_7, Material=ColourSwatch(SwatchColor=RGB(255, 214, 255)))

# ---- group: TOWER
Z_20 = UnitZ(Factor=Slider(180, range=0..1000))
ellipse_2 = Ellipse(Plane=PlaneXY(0, 0, 0), Radius1=Slider(40, range=0..100), Radius2=Slider(40, range=0..100))  # -> Ellipse, Focus1, Focus2
move_22 = Move(Geometry=ellipse_2.Ellipse, Motion=Z_20)  # -> Geometry, Transform
area_3 = Area(Geometry=ellipse_2.Ellipse)  # -> Area, Centroid
# SHELL TWIST
number_slider_18 = Slider(378, range=0..1000)
area_4 = Area(Geometry=move_22.Geometry)  # -> Area, Centroid
scale_3 = Scale(Geometry=move_22.Geometry, Center=area_4.Centroid, Factor=Slider(-0.01, range=-1..0))  # -> Geometry, Transform
loft_14 = Loft(
    Curves=[scale_3.Geometry, ellipse_2.Ellipse],
    Options={Adjust=False, Closed=False, LoftEnds=0, LoftSimp=0, LoftType=0, Rebuild=10, Refit=0.01})
ln_9 = Line(StartPoint=area_3.Centroid, EndPoint=area_4.Centroid)
number_slider_19 = Slider(8, range=0..10)
twist_2 = Twist(Geometry=loft_14, Axis=ln_9, Angle=degrees(number_slider_18), Infinite=False, Rigid=False)
debrep_4 = DeconstructBrep(Brep=twist_2)  # -> Faces, Edges, Vertices
mesh_uv_2 = MeshSurface(Surface=debrep_4.Faces, UCount=number_slider_19, VCount=number_slider_19, Overhang=True, Equalize=False)
wbframe_2 = WeaverbirdsPictureFrame(MeshPolylines=mesh_uv_2, Distance=5, InsetType=0)  # -> flatten(OutMesh)
mjoin_2 = MeshJoin(Meshes=wbframe_2)
wbthicken_2 = WeaverbirdsMeshThicken(MeshCurves=mjoin_2, Distance=Slider(1, range=0..10), OffsetType=0)  # -> flatten(OutputMeshCurves)
# INNER TWIST 2
wbcatmullclark_2 = WeaverbirdsCatmullClarkSubdivision(MeshCurves=wbthicken_2, Level=Slider(3, range=0..10), SmoothNakedEdges=1)
swatch_7 = ColourSwatch(SwatchColor=RGB(255, 255, 255))
preview_20 = CustomPreview(Geometry=[wbthicken_2, wbcatmullclark_2], Material=ColourSwatch(SwatchColor=RGB(255, 214, 255)))

# ----
X_9 = UnitX(Factor=Slider(4000, range=-1000..4000))
Y_9 = UnitY(Factor=Slider(-134, range=-2000..2001))
addition_6 = Addition(A=X_9, B=Y_9)
amp_15 = Amplitude(Vector=addition_6, Amplitude=Slider(-199, range=-299..300))
move_23 = Move(Geometry=wbcatmullclark_2, Motion=amp_15)  # -> Geometry, Transform
# INNER TWIST MOVE
rot3d_5 = Rotate3D(Geometry=move_23.Geometry, Angle=degrees(Slider(3463, range=0..5000)), Center=Point(0, 0, 0), Axis=Vector(0, 0, 1))  # -> Geometry, Transform
preview_21 = CustomPreview(Geometry=rot3d_5.Geometry, Material=ColourSwatch(SwatchColor=RGB(212, 205, 182)))

merge_7 = Merge(Data1=rot3d_2.Geometry, Data2=rot3d_3.Geometry, Data3=rot3d_4.Geometry)
merge_8 = Merge(Data1=cap_2, Data2=pipe_4, Data3=pipe_3, Data4=cone.Cone, Data5=pipe_4, Data6=cone_2.Cone, Data7=cap_4, Data8=loft_4)
swatch_8 = ColourSwatch(SwatchColor=RGB(227, 242, 235))
swatch_9 = ColourSwatch(SwatchColor=RGB(222, 255, 255))

# ---- group: RIBBONS
cir_5 = Circle(Plane=PlaneXY(0, 0, 0), Radius=Slider(39, range=0..100))
Z_21 = UnitZ(Factor=1)
series_7 = Series(Start=Slider(2, range=0..100), Step=Slider(24, range=0..100), Count=Slider(8, range=0..10))
amp_16 = Amplitude(Vector=Z_21, Amplitude=series_7)
dom_6 = ConstructDomain(DomainStart=Slider(1, range=0..1), DomainEnd=Slider(0.01, range=0..0.1))
range_4 = Range(Domain=dom_6, Steps=Slider(7, range=0..10))
pt_9 = ConstructPoint(XCoordinate=Slider(0, range=0..100), YCoordinate=Slider(0, range=0..100), ZCoordinate=Slider(0, range=0..100))
scale_4 = Scale(Geometry=cir_5, Center=pt_9, Factor=range_4)  # -> Geometry, Transform
move_24 = Move(Geometry=scale_4.Geometry, Motion=amp_16)  # -> Geometry, Transform
series_8 = Series(Start=Slider(0, range=0..100), Step=Slider(20, range=0..100), Count=Slider(6, range=0..10))
rotate_4 = Rotate(Geometry=move_24.Geometry, Angle=series_8, Plane=PlaneXY(0, 0, 0))  # -> Geometry, Transform
divide_21 = DivideCurve(Curve=rotate_4.Geometry, Count=Slider(4, range=0..10), Kinks=False)  # -> Points, Tangents, Parameters
flip_4 = FlipMatrix(Data=divide_21.Points)
divide_22 = DivideCurve(Curve=rotate_4.Geometry, Count=Slider(4, range=0..10), Kinks=False)  # -> Points, Tangents, Parameters
Y_10 = UnitY(Factor=1)
intcrv_6 = Interpolate(Vertices=flip_4, Degree=3, Periodic=False, KnotStyle=1)  # -> Curve, Length, Domain
amp_17 = Amplitude(Vector=Y_10, Amplitude=Slider(2, range=-200..201))
move_25 = Move(Geometry=divide_22.Points, Motion=amp_17)  # -> Geometry, Transform
Z_22 = UnitZ(Factor=1)
flip_5 = FlipMatrix(Data=move_25.Geometry)
Z_23 = UnitZ(Factor=1)
amp_18 = Amplitude(Vector=Z_22, Amplitude=Slider(16, range=0..30))
move_26 = Move(Geometry=intcrv_6.Curve, Motion=amp_18)  # -> Geometry, Transform
intcrv_7 = Interpolate(Vertices=flip_5, Degree=3, Periodic=False, KnotStyle=1)  # -> Curve, Length, Domain
number_slider_20 = Slider(3, range=0..10)
loft_15 = Loft(
    Curves=[intcrv_6.Curve, move_26.Geometry],
    Options={Adjust=False, Closed=False, LoftEnds=0, LoftSimp=0, LoftType=0, Rebuild=10, Refit=0.01})
Y_11 = UnitY(Factor=number_slider_20)
Z_24 = UnitZ(Factor=number_slider_20)
divide_23 = DivideCurve(Curve=rotate_4.Geometry, Count=Slider(4, range=0..10), Kinks=False)  # -> Points, Tangents, Parameters
offset_11 = OffsetSurface(Surface=loft_15, Distance=0, Retrim=True)
amp_19 = Amplitude(Vector=Z_23, Amplitude=Slider(4, range=0..100))
extr_7 = Extrude(Base=offset_11, Direction=Y_11)
move_27 = Move(Geometry=divide_23.Points, Motion=amp_19)  # -> Geometry, Transform
flip_6 = FlipMatrix(Data=move_27.Geometry)
cap_8 = CapHoles(Brep=extr_7)
intcrv_8 = Interpolate(Vertices=flip_6, Degree=3, Periodic=False, KnotStyle=1)  # -> Curve, Length, Domain
join_9 = JoinCurves(Curves=[intcrv_6.Curve, intcrv_8.Curve], Preserve=False)
merge_9 = Merge(Data1=intcrv_6.Curve, Data2=intcrv_7.Curve, Data3=intcrv_8.Curve)
loft_16 = Loft(
    Curves=[merge_9, join_9],
    Options={Adjust=False, Closed=False, LoftEnds=0, LoftSimp=0, LoftType=0, Rebuild=10, Refit=0.01})
offset_12 = OffsetSurface(Surface=loft_16, Distance=0, Retrim=True)
preview_22 = CustomPreview(Geometry=offset_12, Material=swatch_9)

# ----
X_10 = UnitX(Factor=Slider(4000, range=-1000..4000))
Y_12 = UnitY(Factor=Slider(-134, range=-2000..2001))
addition_7 = Addition(A=X_10, B=Y_12)
amp_20 = Amplitude(Vector=addition_7, Amplitude=Slider(-199, range=-299..300))
move_28 = Move(Geometry=cap_8, Motion=amp_20)  # -> Geometry, Transform
# SHELL TWIST MOVE
rot3d_6 = Rotate3D(Geometry=move_28.Geometry, Angle=degrees(Slider(3463, range=0..5000)), Center=Point(0, 0, 0), Axis=Vector(0, 0, 1))  # -> Geometry, Transform
preview_23 = CustomPreview(Geometry=rot3d_6.Geometry, Material=swatch_9)

# ----
# SHELL TWIST 2
preview_24 = CustomPreview(Geometry=cap_8, Material=ColourSwatch(SwatchColor=RGB(222, 255, 255)))

Z_25 = Slider(29.95, range=0..40)
x_end = Slider(21.9, range=0..40)
z_end = Slider(0, range=0..40)
y_end = Slider(1.2, range=0..40)
number_slider_21 = Slider(9.49, range=0..10)
X_11 = UnitX(Factor=x_end)
Y_13 = UnitY(Factor=y_end)
Z_26 = UnitZ(Factor=z_end)
rectangle_3 = Rectangle(Plane=PlaneXY(0, 0, 0), XSize=number_slider_21, YSize=number_slider_21, Radius=0)  # -> Rectangle, Length
addition_8 = Addition(A=X_11, B=Y_13, C=Z_26)
disc = Discontinuity(Curve=rectangle_3.Rectangle, Level=1)  # -> Points, Parameters
panel_5 = Panel("""1
2""")
list = ValueList({"rectangle": 0, "pleats": 1}, selected="pleats")
item_5 = ListItem(List=disc.Points, Index=panel_5, Wrap=True)
Z_27 = UnitZ(Factor=Z_25)
move_29 = Move(Geometry=item_5, Motion=addition_8)  # -> Geometry, Transform
bzspan = BezierSpan(StartPoint=item_5, StartTangent=Z_27, EndPoint=move_29.Geometry, EndTangent=Z_27)  # -> Curve, Length, Domain
item_6 = ListItem(List=bzspan.Curve, Index=0, Wrap=True)  # -> Item, Item1
Y_14 = UnitY(Factor=1)
amp_21 = Amplitude(Vector=Y_14, Amplitude=Slider(53, range=0..100))
Y_15 = UnitY(Factor=Slider(980, range=0..1000))
X_12 = UnitX(Factor=Slider(-402, range=-1000..1001))
addition_9 = Addition(A=X_12, B=Y_15)
amp_22 = Amplitude(Vector=addition_9, Amplitude=Slider(48, range=-299..300))

# ---- group: pleats
offset_13 = Slider(3, range=0..3)
number_slider_22 = Slider(5, range=1..10)
explode_3 = Explode(Curve=rectangle_3.Rectangle, Recursive=True)  # -> Segments, Vertices
panel_6 = Panel("""1
-1""")
hframes = HorizontalFrames(Curve=explode_3.Segments, Count=number_slider_22)  # -> Frames, Parameters
merge_10 = Merge(Data1="0", Data2=number_slider_22)
deplane_3 = DeconstructPlane(Plane=hframes.Frames)  # -> Origin, XAxis, YAxis, ZAxis
lng_3 = ListLength(List=deplane_3.YAxis)
repeat = RepeatData(Data=panel_6, Length=lng_3)
replace = ReplaceItems(List=repeat, Item="0", Indices=merge_10, Wrap=False)
multiplication = Multiplication(A=replace, B=offset_13)
amp_23 = Amplitude(Vector=deplane_3.YAxis, Amplitude=multiplication)
move_30 = Move(Geometry=deplane_3.Origin, Motion=amp_23)  # -> Geometry, Transform
pline_3 = PolyLine(Vertices=move_30.Geometry, Closed=False)
join_10 = JoinCurves(Curves=flatten(pline_3), Preserve=False)

# ----
filter = StreamFilter(Gate=list, Stream0=rectangle_3.Rectangle, Stream1=join_10)
swp2 = Sweep2(Rail1=item_6.Item, Rail2=item_6.Item1, Sections=filter, SameHeight=False)
cap_9 = CapHoles(Brep=swp2)
move_31 = Move(Geometry=cap_9, Motion=amp_22)  # -> Geometry, Transform
cap_10 = CapHoles(Brep=move_31.Geometry)
preview_25 = CustomPreview(Geometry=cap_10, Material=ColourSwatch(SwatchColor=RGB(212, 205, 182)))

X_13 = UnitX(Factor=Slider(762, range=0..1000))
Y_16 = UnitY(Factor=Slider(-55, range=-100..1000))
addition_10 = Addition(A=X_13, B=Y_16)
# TUNNEL ENTRENCE
amp_24 = Amplitude(Vector=addition_10, Amplitude=Slider(-167, range=-299..300))
move_32 = Move(Geometry=cap_10, Motion=amp_24)  # -> Geometry, Transform

rot3d_7 = Rotate3D(Geometry=move_32.Geometry, Angle=degrees(Slider(4934, range=0..5000)), Center=Point(0, 0, 0), Axis=Vector(0, 0, 1))  # -> Geometry, Transform
preview_26 = CustomPreview(Geometry=rot3d_7.Geometry, Material=ColourSwatch(SwatchColor=RGB(212, 205, 182)))
merge_11 = Merge(
    Data1=move_13.Geometry,
    Data2=wbcatmullclark,
    Data3=rot3d_5.Geometry,
    Data4=cap_7,
    Data5=rot3d_6.Geometry,
    Data6=merge_8,
    Data7=merge_7,
    Data8=rot3d_7.Geometry,
    Data9=cap_10,
    Data10=wbthicken)
